# Grasshopper definition cd1_01_staircase.gh (Grasshopper 1.0.7)

# Excercise 01: Staircase
# https://github.com/runxel/computational-design
# see also: https://github.com/runxel/grasshopper-examples
height_of_the_staircase_story_height = Slider(5, range=2..10)
minimal_height_of_riser = Slider(0.18, range=0.15..0.25)
maximal_height_of_riser = Slider(0.22, range=0.15..0.25)
outer_radius = Slider(2.6, range=1..4)
inner_radius = Slider(1.2, range=0..3)
headspace = Slider(2.47, range=2.1..3)
radius_of_the_toprail = Slider(0.03, range=0.01..0.08)
show_construction_help_elements = BooleanToggle(False)
stair_rises_in_clockwise_direction = BooleanToggle(False)
python = GhPythonScript()  # -> path
# ---------- python: Python ----------
""" Provide a method to get the accompanying 
    python code file. Replaces the 'file path' component
    which has no relative path option.
"""

from os import path


thisPath = path.normpath(ghenv.Component.Attributes.Owner.OnPingDocument().FilePath)

_split = path.split(thisPath)
_splitFile = _split[1].split(".")[0]

path_ = path.relpath(_splitFile + ".py", _split[0])
# ---------- end python ----------
file = ReadFile(File=python, PerLineParse=False)
go_to_github = Button()
python_2 = GhPythonScript(
    Code=file,
    HeightOfStaircase=height_of_the_staircase_story_height,
    MinHeightRiser=minimal_height_of_riser,
    MaxHeightRiser=maximal_height_of_riser,
    Radius=outer_radius,
    InnerRadius=inner_radius,
    Clockwise=stair_rises_in_clockwise_direction,
    Headspace=headspace,
    PipeRadius=radius_of_the_toprail,
    ShowWire=show_construction_help_elements)  # -> _wire, _stp, _rsr, _rl, _pst
subtraction = Subtraction(A=outer_radius, B=inner_radius)
orib = OpenRepoInBrowser(open=go_to_github)
laufbreite = Panel(subtraction)

# ==== cluster OpenRepoInBrowser
open = ClusterInput()
python = GhPythonScript(open=open)
# ---------- python: Python ----------
""" A simple 'open in browser' script """

import webbrowser

url = "https://github.com/runxel/computational-design"

if open:
    webbrowser.open(url, new=2)
# ---------- end python ----------
