# Grasshopper definition cd1_02_tower.gh (Grasshopper 1.0.7)

# Excercise 02: Twisted Tower
# https://github.com/runxel/computational-design
# see also: https://github.com/runxel/grasshopper-examples
cross_section_curve = Curve(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)
number_of_storeys = Slider(11, range=1..20)
vertical_divisions = Slider(66, range=3..100)
superness = Slider(3.96, range=0.5..5)
python = GhPythonScript()  # -> path
# ---------- python: Python ----------
""" Provide a method to get the accompanying 
    python code file. Replaces the 'file path' component
    which has no relative path option.
"""

from os import path


thisPath = path.normpath(ghenv.Component.Attributes.Owner.OnPingDocument().FilePath)

_split = path.split(thisPath)
_splitFile = _split[1].split(".")[0]

path_ = path.join(_split[0], _splitFile + ".py")
# ---------- end python ----------
file = ReadFile(File=python, PerLineParse=False)
python_2 = GhPythonScript(
    Code=file,
    Crv1=cross_section_curve,
    DivisionZ=number_of_storeys,
    DivisionV=vertical_divisions,
    Width=Slider(12, range=2..12),
    Superness=superness)  # -> _curves, _panels
planar = IsPlanar(Surface=python_2._panels, Interior=True)  # -> Planar, Plane
mindex = MemberIndex(Set=planar.Planar, Member=True)  # -> Index, Count
lng = ListLength(List=planar.Planar)
division = Division(A=mindex.Count, B=lng)
multiplication = Multiplication(A=division, B=100)
go_to_github = Button()
percentage_of_planar_panels = Panel(multiplication)
orib = OpenRepoInBrowser(open=go_to_github)

# ==== cluster OpenRepoInBrowser
open = ClusterInput()
python = GhPythonScript(open=open)
# ---------- python: Python ----------
""" A simple 'open in browser' script """

import webbrowser

url = "https://github.com/runxel/computational-design"

if open:
    webbrowser.open(url, new=2)
# ---------- end python ----------
