# Grasshopper definition cd1_03_rose_window.gh (Grasshopper 1.0.7)

minimal_radius = Slider(1.5, range=0.2..5)
# Excercise 03: Apollonian Gasket
# https://github.com/runxel/computational-design
# see also: https://github.com/runxel/grasshopper-examples
# For certain combinations of sizes it is
# impossible to generate an apollonian gasket.
# This is true e.g. for b3=2(√b1⋅b2)+b1+b2
# The radius would be infinite.
bounding_circle_radius = Slider(200, range=100..300)
circle_size = Slider(0.5, range=0..1)
dom = ConstructDomain(DomainStart=expr("x/10", bounding_circle_radius), DomainEnd=expr("x*0.9", bounding_circle_radius))
remap = RemapNumbers(Value=circle_size, Source=Domain(0, 1), Target=dom)  # -> Mapped, Clipped
# The circle MUST be completely in the first quadrant
# of a cartesian coordinate system.
# Otherwise Vieta jumping doesn't work.
cir = Circle(Plane=PlaneXY(0, 0, 0), Radius=bounding_circle_radius)
vec = VectorXYZ(XComponent=bounding_circle_radius, YComponent=bounding_circle_radius, ZComponent=0)  # -> Vector, Length
go_to_github = Button()
move = Move(Geometry=cir, Motion=vec.Vector)  # -> Geometry, Transform
crv = Curve(move.Geometry)
orib = OpenRepoInBrowser(open=go_to_github)
reset = Button()
python = GhPythonScript(port=reset)  # -> path
# ---------- python: Python ----------
""" Provide a method to get the accompanying 
    python code file. Replaces the 'file path' component
    which has no relative path option.
"""

from os import path


thisPath = path.normpath(ghenv.Component.Attributes.Owner.OnPingDocument().FilePath)

_split = path.split(thisPath)
_splitFile = _split[1].split(".")[0]

path_ = path.join(_split[0], _splitFile + ".py")
# ---------- end python ----------
file = ReadFile(File=python, PerLineParse=False)
python_2 = GhPythonScript(Code=file, StartCircle=crv, CircleSize=remap.Mapped, MinRadius=minimal_radius)  # -> _startCrc, _d
flatten = FlattenTree(Tree=[python_2._d, python_2._startCrc], Path="{0}")
len = Length(Curve=flatten)
sort = SortList(Keys=len, ValuesA=flatten)  # -> Keys, ValuesA
lng = ListLength(List=sort.Keys)
subtraction = Subtraction(A=lng, B=Slider(10, range=0..10))
split = SplitList(List=sort.Keys, Index=subtraction)  # -> ListA, ListB
bnd = Bounds(Numbers=split.ListA)
dedomain = DeconstructDomain(Domain=bnd)  # -> Start, End
rev = ReverseList(List=split.ListA)
gradient = Gradient(
    LowerLimit=dedomain.End,
    UpperLimit=dedomain.Start,
    Parameter=split.ListA,
    stops=[0.149: RGB(0, 98, 0), 0.559: RGB(81, 175, 17), 0.869: RGB(159, 198, 146), 0.945: RGB(170, 235, 41), 1: RGB(221, 255, 53)])
split_2 = SplitList(List=sort.ValuesA, Index=subtraction)  # -> ListA, ListB
preview = CustomPreview(Geometry=split_2.ListB, Material=ColourSwatch(SwatchColor=RGB(58, 89, 32)))
preview_2 = CustomPreview(Geometry=split_2.ListA, Material=gradient)

# ==== cluster OpenRepoInBrowser
open = ClusterInput()
python = GhPythonScript(open=open)
# ---------- python: Python ----------
""" A simple 'open in browser' script """

import webbrowser

url = "https://github.com/runxel/computational-design"

if open:
    webbrowser.open(url, new=2)
# ---------- end python ----------
