# Grasshopper definition cd1_04_floor_variation.gh (Grasshopper 1.0.7)

# Excercise 04: Tower Variation
# https://github.com/runxel/computational-design
# see also: https://github.com/runxel/grasshopper-examples
pt = Point(Point(0, 0, 0))
number_of_stories = Slider(20, range=1..20)
# Play with the graph types
# and the graphs itself!
range = Range(Domain=Domain(0, 1), Steps=number_of_stories)
height_of_story = Slider(3.2, range=2.5..4)
# Sides of our Tower
list = ValueList({"Three": 3, "Four": 4, "Five": 5, "Six": 6}, selected="Three")
rotation_of_tower = Slider(90, range=0..90)
# ! Caution !
sierpinski_triangles_on = BooleanToggle(False)
# set to false for bit faster view
graph = GraphMapper(range, x0=0, x1=1, y0=0, y1=1, container_name="Gaussian", factor=0.4642782807, mean=0.486628443, sdev=0.2097434103)
dom = ConstructDomain(DomainStart="30", DomainEnd="50")
remap = RemapNumbers(Value=graph, Source=Domain(1, 0), Target=dom)  # -> Floorsize, Clipped
reset = Button()
python = GhPythonScript(port=reset)  # -> path
# ---------- python: Python ----------
""" Provide a method to get the accompanying 
    python code file. Replaces the 'file path' component
    which has no relative path option.
"""

from os import path


thisPath = path.normpath(ghenv.Component.Attributes.Owner.OnPingDocument().FilePath)

_split = path.split(thisPath)
_splitFile = _split[1].split(".")[0]

path_ = path.join(_split[0], _splitFile + ".py")
# ---------- end python ----------
go_to_github = Button()
file = ReadFile(File=python, PerLineParse=False)
orib = OpenRepoInBrowser(open=go_to_github)
python_2 = GhPythonScript(
    Code=file,
    Pos=pt,
    Stories=number_of_stories,
    Height=height_of_story,
    Floorsize=remap.Floorsize,
    Sidecount=list,
    PlaneRot=rotation_of_tower,
    ST_ON=sierpinski_triangles_on)  # -> _wire, _fac, _ST

# ==== cluster OpenRepoInBrowser
open = ClusterInput()
python = GhPythonScript(open=open)
# ---------- python: Python ----------
""" A simple 'open in browser' script """

import webbrowser

url = "https://github.com/runxel/computational-design"

if open:
    webbrowser.open(url, new=2)
# ---------- end python ----------
