# Grasshopper definition cd1_05_paneling1.gh (Grasshopper 1.0.7)

# Excercise 05: Paneling I – The Oval Stadium
# https://github.com/runxel/computational-design
# see also: https://github.com/runxel/grasshopper-examples
# Midpoint
basept = Point(Point(0, 0, 0))
# OVAL bottom
radii_smaller_circles = Slider(8, range=1..10)
horizontal_spacing = Slider(6.6, range=1..10)
vertical_spacing = Slider(45.5, range=10..89)
total_height = Slider(6.15, range=3..8)
offset_for_mid_oval = Slider(1.6, range=0..3.5)
height_mid_oval = Slider(0.737, range=0.2..0.9)
offset_for_top_oval = Slider(4.41, range=0..8)
number_of_ditches = Slider(22, range=10..50)
opening_in_deg_2 = Slider(12.5, range=0..20)
number_of_horizontal_divisions = Slider(10, range=10..34)
reset = Button()
python = GhPythonScript(port=reset)  # -> path
# ---------- python: Python ----------
""" Provide a method to get the accompanying 
    python code file. Replaces the 'file path' component
    which has no relative path option.
"""

from os import path


thisPath = path.normpath(ghenv.Component.Attributes.Owner.OnPingDocument().FilePath)

_split = path.split(thisPath)
_splitFile = _split[1].split(".")[0]

path_ = path.join(_split[0], _splitFile + ".py")
# ---------- end python ----------
go_to_github = Button()
file = ReadFile(File=python, PerLineParse=False)
orib = OpenRepoInBrowser(open=go_to_github)
python_2 = GhPythonScript(
    Code=file,
    BasePt=basept,
    RadiusSmall=radii_smaller_circles,
    OvalWidth=horizontal_spacing,
    OvalLength=vertical_spacing,
    Height=total_height,
    OffsetMid=offset_for_mid_oval,
    MidOHeight=height_mid_oval,
    OffsetTop=offset_for_top_oval,
    NDitches=number_of_ditches,
    OpenAngle=opening_in_deg_2,
    NHorDiv=number_of_horizontal_divisions)  # -> Debug, _construction, _surfaces, _linework, _verboseOval, _verboseConstr, _verbosePoints
panel = Panel(python_2.Debug)
suirify = Suirify(python_2._verbosePoints)
geo = Geometry(python_2._verboseOval)
geo_2 = Geometry(python_2._verboseConstr)
geo_3 = Geometry(python_2._construction)
geo_4 = Geometry(python_2._surfaces)
geo_5 = Geometry(python_2._linework)
geo_6 = Geometry(suirify)

# ==== cluster OpenRepoInBrowser
open = ClusterInput()
python = GhPythonScript(open=open)
# ---------- python: Python ----------
""" A simple 'open in browser' script """

import webbrowser

url = "https://github.com/runxel/computational-design"

if open:
    webbrowser.open(url, new=2)
# ---------- end python ----------
