# Grasshopper definition cd1_06_paneling2.gh (Grasshopper 1.0.7)

# ---- group: TILING
# HOW TO USE: There are saved states for easy understanding saved under "Solution"
# 
# 
# 
# internalised Surfaces to map unto ––•
# 
# 
# 
# Select the surface to map on ––•
# 
# 
# 
# my grid ––•
# 
# 
# 
# surface mapping ––•
size_of_one_tile = Slider(1, range=0..2)
extent_x_direction = Slider(6, range=1..50)
extent_y_direction = Slider(16, range=1..50)
# Here the tiling of the grid is made.
# Use the "top" viewport for accurate grid handling.
# [Drawn from {0;0;0}]
# 
# "contact angle" changes the angles of the stars.
contact_angle = Slider(66, range=0..100)
python = GhPythonScript(Size=size_of_one_tile, Ex=extent_x_direction, Ey=extent_y_direction, contactAngle=contact_angle)  # -> debug, simplify(basetiling), simplify(iStarPatIn), simplify(iStarPatOut), simplify(verbose); inputs Ex: Int32, Ey: Int32
# ---------- python: Python ----------
__author__ = "Lucas Becker"
__version__ = "2018-12-11 v1"

"""
:Islamic Surface Paneling:

TODO:
    * angles 22.5° and 45° are making problems
    * implement more pattern
"""

############# libs ################
# import RhinoCommon and all GH components for node in code
# import treehelpers for outputting datatrees {{ONLY RHINO 6}}
# import the math stuff, and document methods, and a hella more
import Rhino.Geometry as rg
import Rhino.RhinoMath as rm
import ghpythonlib.components as ghcomp
import ghpythonlib.treehelpers as th
import Grasshopper.Kernel.Data as ghpath
import math
from scriptcontext import doc

########### variables #############
# ╒═══════ in ═════╤╤═════ out ═════╕
# ├┄┄┄┄┄┄┄┄┄┄┄┄┄┄┄┄┤├┄┄┄┄┄┄┄┄┄┄┄┄┄┄┄┤
# │  Size          ││  debug        │
# │  Ex            ││  _baseTiling  │
# │  Ey            ││  _iStarPatIn  │
# │  contactAngle  ││  _iStarPatOut │
# │                ││  _verbose     │
# └────────────────┴┴───────────────┘


if Ex < 1 or Ey < 1:
    raise ValueError("Ex and Ey have to be at least 1.")

radiusOct = Size/2
# calculate side length of an octogon
sl = 2* radiusOct * (math.sqrt(2)-1)
# calc the leg of triangle with sl as hypotenuse
kath = math.sqrt((sl/2)**2 *2)


########### functions #############
def shift(l, n):
    """Shift a list grasshopper style."""
    n = n % len(l)
    head = l[:n]
    l[:n] = []
    l.extend(head)
    return l

def tiling(radius, nx, ny):
    """
    Provides base tiling geometry, namely closed touching polygons.
    Tiling Notation: {4,8²}
    (Holes in this structure are not allowed.)
    """
    # octogons first
    sidecount = 8 # octogon
    octogons, rectangles = [], []

    lastPt = rg.Point3d(0,0,0) # our starting point
    for j in range(1, ny+1): ###### OCTOGONS
        temp = []
        for i in range(nx):
            plane = rg.Plane(lastPt, rg.Vector3d.ZAxis)
            circumCircle = rg.Circle(plane, radius)
            temp.append(rg.Polyline.CreateCircumscribedPolygon(circumCircle, sidecount).ToPolylineCurve())
            lastPt.X += (2*sl + 2*kath) # gap in x direction
        octogons.append(temp)

        if j % 2: # modulus, every second row
            lastPt.X = sl + kath
            lastPt.Y += sl + kath
        else:
            lastPt.X = 0
            lastPt.Y += sl + kath

    lastPt = rg.Point3d(sl+kath,0,0) # our starting point
    for j in range(1, ny+1): ####### RECTANGLES
        temp = []
        for i in range(nx):
            plane = rg.Plane(lastPt, rg.Vector3d.ZAxis)
            recDom = rg.Interval(-sl/2, sl/2)
            temp.append(rg.Rectangle3d(plane, recDom, recDom).ToPolyline().ToPolylineCurve())
            lastPt.X += (2*sl + 2*kath) # gap in x direction
        rectangles.append(temp)

        if j % 2: # modulus, every second row
            lastPt.X = 0
            lastPt.Y += sl + kath
        else:
            lastPt.X = sl + kath
            lastPt.Y += sl + kath

    return [octogons, rectangles]

def hankins(polylist, contactAngle=60):
    """
    Provides an islamic star pattern based on the paper of C.S. Kaplan
    (http://www.cgl.uwaterloo.ca/~csk/papers/kaplan_gi2005.pdf)
    This is called "Hankin's Method" since he was the first Western scientist to describe these patterns.
    For this function to work correctly you need a set of polygons which are touching eachother without any gaps.
    """
    segments, midpts, startpts, endpts, vec1, vec2, sdl1, sdl2, lxlPt, innerLines, outerLines = [], [], [], [], [], [], [], [], [], [], []

    for item in polylist:
        segments.append(item.DuplicateSegments())
        
    for m, seglist in enumerate(segments):
        tempMid, tempStart, tempEnd, tempVec1, tempVec2, tl1, tl2, lxl = [], [], [], [], [], [], [], []


        # 1) points
        for k, seg in enumerate(seglist):
            # get the points of the segments
            # ! IMPORTANT: you have to use .PointAtNormalizedLength
            tempMid.append(seg.PointAtNormalizedLength(0.5))
            tempStart.append(seg.PointAtStart)
            tempEnd.append(seg.PointAtEnd)

        # nested lists
        midpts.append(tempMid)
        startpts.append(tempStart)
        endpts.append(tempEnd)

        # 2) vectors
        for k, seg in enumerate(seglist):
            # Vector: Endpt - Startpt
            # also rotate them
            tv1 = rg.Vector3d(startpts[m][k] - midpts[m][k])
            rg.Vector3d.Rotate(tv1, rm.ToRadians(-contactAngle), rg.Vector3d.ZAxis)
            tempVec1.append(tv1)
            tv2 = rg.Vector3d(endpts[m][k] - midpts[m][k])
            rg.Vector3d.Rotate(tv2, rm.ToRadians(contactAngle), rg.Vector3d.ZAxis)
            tempVec2.append(tv2)

        vec1.append(tempVec1)
        vec2.append(tempVec2)

        # 3) SDL lines
        for k, seg in enumerate(seglist):
            tl1.append(rg.Line(midpts[m][k], vec1[m][k], sl/3))
            tl2.append(rg.Line(midpts[m][k], vec2[m][k], sl/3))

        sdl1.append(tl1)
        sdl2.append(tl2)

        # 4) Line intersections, get points (inner points of a star)
        for k, seg in enumerate(seglist):
            lxl.append(ghcomp.LineXLine(sdl1[m][k], sdl2[m][k-1])[2])
        lxlPt.append(lxl)

    # inner polygons (stars)
    # some advanced slicing going on; dont worry, its acutally very pythonic
    for l, crv in enumerate(polylist):
        # listIn1.append(listIn1.pop(0)) # poor man's list shifting
        # shift(listIn1, -1)
        resultInner = [None]*(len(lxlPt[l][:])+len(midpts[l][:]))
        resultInner[::2] = lxlPt[l][:]
        resultInner[1::2] = midpts[l][:]
        resultInner.append(lxlPt[l][0]) # to close the polyline

        innerLines.append(rg.Polyline(resultInner).ToNurbsCurve())

    # outer polygons
    for p, poly in enumerate(polylist):
        tl = []
        for v in range(len(segments[p])):
            resultOuter = [midpts[p][v], startpts[p][v], midpts[p][v-1], lxlPt[p][v], midpts[p][v]]
            tl.append(rg.Polyline(resultOuter).ToNurbsCurve())
        outerLines.append(tl)

    # for visual clues how this is made
    global verbose
    verbose = segments, midpts, startpts, endpts, sdl1, sdl2, lxlPt

    return innerLines, outerLines


#################
#### M a i n ####
#################

# gets the base polygon tiling
base = th.list_to_tree( tiling(radiusOct, Ex, Ey))
# OUTPUT #
_basetiling = base

# Flatten it and make it a list again
# Note: we have to call tiling again, because I didn't found an easy way to make
# a deep copy of a tree in Python (and "Flatten()" is a mutable command)
# and I want to retain the octogons and rectangles in different branches
tiles = th.list_to_tree( tiling(radiusOct, Ex, Ey))
tiles.Flatten()
tiles = th.tree_to_list(tiles)
# OUTPUT #
_iStarPatIn = th.list_to_tree( hankins(tiles, contactAngle)[0])
_iStarPatOut = th.list_to_tree( hankins(tiles, contactAngle)[1])

_verbose = th.list_to_tree(verbose)
# ---------- end python ----------

# ---- group: Select a Surface to map here
# Excercise 06: Paneling II
# https://github.com/runxel/computational-design
# see also: https://github.com/runxel/grasshopper-examples
which_surface = Slider(1, range=0..1)

# ----
reset = Button()
python_2 = GhPythonScript(port=reset)  # -> path
# ---------- python_2: Python ----------
""" Provide a method to get the accompanying 
    python code file. Replaces the 'file path' component
    which has no relative path option.
"""

from os import path


thisPath = path.normpath(ghenv.Component.Attributes.Owner.OnPingDocument().FilePath)

_split = path.split(thisPath)
_splitFile = _split[1].split(".")[0]

path_ = path.join(_split[0], _splitFile + ".py")
# ---------- end python_2 ----------
go_to_github = Button()
file = ReadFile(File=python_2, PerLineParse=False)

# ----
# This is used to make the seam on a closed surface adjustable (you would otherwise get holes on closed surfaces with non-rectangular grids).
# 
# This is achieved by modifying the source domain.
magic_number = Panel("0.292")
multiplication = Multiplication(A=size_of_one_tile, B=magic_number)

orib = OpenRepoInBrowser(open=go_to_github)

# ---- group: For Reference: see the base Pattern
split = SplitTree(Data=python.basetiling, Masks=flatten("{0;?}"))  # -> Positive, Rectangles

# ---- group: just a quick test surface
uniform_radius = BooleanToggle(True)
radius_mid = Slider(5.7, range=3..14)
pt = Point(Point(-53.93039485, 7.396461583, 0))
radius_bottom = Slider(9.19, range=8..18)
radius_top = Slider(8, range=8..30)
height = Slider(17.42, range=8..30)
dccsrf = DoubleCurvedClosedSurface(S=pt, B=radius_bottom, B_2=radius_mid, B_3=radius_top, A=height, G=uniform_radius)
srf = Surface(dccsrf)

# ---- group: to see construction elements
geo = Geometry(python.verbose)

# ---- group: Surface from the exercise
srf_2 = Surface(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)

# ----
filter = StreamFilter(Gate=which_surface, Stream0=srf, Stream1=srf_2)

# ---- group: 2D
geo_2 = Geometry(python.iStarPatIn)
geo_3 = Geometry(python.iStarPatOut)

# ----
flatten = FlattenTree(Tree=[geo_2, geo_3], Path="{0}")

# ---- group: 2D (continued)
preview = CustomPreview(Geometry=flatten, Material=ColourSwatch(SwatchColor=RGB(18, 68, 148)))

# ---- group: The Mapping onto the Surface
# Here our grid will finally get mapped unto our selected surface.
python_3 = GhPythonScript(Surface=filter, Grid=flatten(flatten), adjSeam=multiplication)  # -> debug, ptsOnSrf, polyCrv, panels; inputs Surface: Surface, Grid: list of Curve
# ---------- python_3: Python ----------
__author__ = "Lucas Becker"
__version__ = "2018-12-11 v1"

"""
:Mapping a grid unto a Surface:

"""

############# libs ################
import Rhino.Geometry as rg
import ghpythonlib.components as ghc
import Grasshopper.DataTree as DataTree
import Grasshopper.Kernel.Data.GH_Path as GH_Path

########### variables #############
# ╒════ in ════╤╤═══ out ═════╕
# ├┄┄┄┄┄┄┄┄┄┄┄┄┤├┄┄┄┄┄┄┄┄┄┄┄┄┄┤
# │  Surface   ││  debug      │
# │  Grid      ││  _ptsOnSrf  │
# │  adjSeam   ││  _polyCrv   │
# │            ││  _panels    │
# └────────────┴┴─────────────┘

# test whether the surface is closed (has a seam) or not
bUSeam = rg.Surface.IsClosed(Surface, 0) # seam is in U space
bVSeam = rg.Surface.IsClosed(Surface, 1) # seam is in V space

#################
#### M a i n ####
#################

# 1) Reparamtrize the surface space
domain = rg.Interval(0, 1)
Surface.SetDomain(0, domain)
Surface.SetDomain(1, domain)

# 2) Getting the Grid Domains
GridPtsX = []
GridPtsY = []
for crv in Grid:
    crvPts = ghc.Discontinuity(crv,1)[0] # Get the cell corner points
    for pt in crvPts:
        GridPtsX.append(pt.X)
        GridPtsY.append(pt.Y)
# create domain [ternary operator]
domainX = rg.Interval(min(GridPtsX), max(GridPtsX)-adjSeam) if bUSeam else rg.Interval(min(GridPtsX), max(GridPtsX))
domainY = rg.Interval(min(GridPtsY)-adjSeam, max(GridPtsY)) if bVSeam else rg.Interval(min(GridPtsY), max(GridPtsY))

# 3) Remaping the points
surfPts = DataTree[rg.Point3d]()
for pathNo, crv in enumerate(Grid):
    crvPts = ghc.Discontinuity(crv, 1)[0]
    path = GH_Path(pathNo)
    for pt in crvPts:
        x = ghc.RemapNumbers(pt.X, domainX, domain)[0]
        y = ghc.RemapNumbers(pt.Y, domainY, domain)[0]
        surfPts.Add(Surface.PointAt(x,y),path)

# 4) Creating the panels
surcCrvs = DataTree[rg.Curve]()
survPanels = DataTree[rg.Brep]()
for i in range(surfPts.BranchCount):
    path = GH_Path(i)
    branch = surfPts.Branch(i)
    flatCrv = []
    if branch.Count > 3:
        # let the GH do the work for us
        plane = ghc.PlaneFit(branch)[0]
        for i in range(0, branch.Count):
            pt = plane.ClosestPoint(branch[i])
            flatCrv.append(pt)
    else:
        flatCrv = branch
    closedCrv = ghc.PolyLine(flatCrv, True)
    surcCrvs.Add(closedCrv, path)
    Panel = ghc.BoundarySurfaces(closedCrv)
    survPanels.Add(Panel, path)


#################
#### _ O U T ####
#################
_ptsOnSrf = surfPts
_polyCrv = surcCrvs
_panels = survPanels
# ---------- end python_3 ----------
point = Point(python_3.ptsOnSrf)
curve = Curve(python_3.polyCrv)
srf_3 = Surface(python_3.panels)

# ----
color_the_geometry = ColorTheGeometry(B=srf_3)
preview_2 = CustomPreview(Geometry=srf_3, Material=color_the_geometry)

# ==== cluster DoubleCurvedClosedSurface: Generates a convex or concave shaped, double curved closed Surface (seam on U)
S = ClusterInput()
B = ClusterInput()
B_2 = ClusterInput()
B_3 = ClusterInput()
A = ClusterInput()
G = ClusterInput()
pdecon = Deconstruct(Point=S)  # -> XComponent, YComponent, ZComponent
subtraction = Subtraction(A=A, B=pdecon.ZComponent)
addition = Addition(A=pdecon.XComponent, B=B)
addition_2 = Addition(A=pdecon.XComponent, B=B_2)
addition_3 = Addition(A=pdecon.XComponent, B=B_3)
addition_4 = Addition(A=pdecon.ZComponent, B=A)
Z = UnitZ(Factor=1)
division = Division(A=subtraction, B="2")
line = LineSDL(Start=S, Direction=Z, Length=1)
filter = StreamFilter(Gate=G, Stream0=addition_3, Stream1=addition)
pt = ConstructPoint(XCoordinate=addition, YCoordinate=pdecon.YComponent, ZCoordinate=0)
pt_2 = ConstructPoint(XCoordinate=addition_2, YCoordinate=pdecon.YComponent, ZCoordinate=division)
pt_3 = ConstructPoint(XCoordinate=filter, YCoordinate=pdecon.YComponent, ZCoordinate=addition_4)
intcrv = Interpolate(Vertices=[pt, pt_2, pt_3], Degree=3, Periodic=False, KnotStyle=1)  # -> Curve, Length, Domain
revsrf = Revolution(Curve=intcrv.Curve, Axis=line, Domain=Domain(0, 6.283185307))
S_2 = ClusterOutput(revsrf)

# ==== cluster ColorTheGeometry
B = ClusterInput()
edges = BrepEdges(Brep=B)  # -> Naked, Interior, NonManifold
lng = ListLength(List=edges.Naked)
bnd = Bounds(Numbers=flatten(lng))
dedomain = DeconstructDomain(Domain=bnd)  # -> Start, End
gradient = Gradient(
    LowerLimit=dedomain.Start,
    UpperLimit=dedomain.End,
    Parameter=lng,
    stops=[0: RGB(234, 126, 0), 0.32: RGB(173, 203, 249), 1: RGB(75, 107, 169)])
C = ClusterOutput(gradient)

# ==== cluster OpenRepoInBrowser
open = ClusterInput()
python = GhPythonScript(open=open)
# ---------- python: Python ----------
""" A simple 'open in browser' script """

import webbrowser

url = "https://github.com/runxel/computational-design"

if open:
    webbrowser.open(url, new=2)
# ---------- end python ----------
