# Grasshopper definition cd1_07_image_sampling.gh (Grasshopper 1.0.7)
# plug-ins: AstarPathFinder

# ---- group: VIDEO STREAM
# WebcamStream Component of "Falcon"
webcamstream = WebcamStream()  # disabled
dam = DataDam(DataA=webcamstream, BufferDelay=10000000, BufferMode=2)  # disabled
showimage = ShowImage(Image=webcamstream)  # disabled

# ---- group: Relative Path (file must be in same folder)
python = GhPythonScript(file_name="cd1_07_worldmap.jpg")  # -> relPath
# ---------- python: Python ----------
# get file path of this document
thisFilePath = ghenv.Component.OnPingDocument().FilePath

# use it as a relative base
newFilePath = "\\".join(thisFilePath.split("\\")[:-1])
newFilePath = newFilePath + "\\" + file_name

relPath = newFilePath
# ---------- end python ----------

# ---- group: INPUT
# Excercise 07: Image Sampling
# https://github.com/runxel/computational-design
# see also: https://github.com/runxel/grasshopper-examples
# 1) Set your Input here
list = ValueList({"Image: Absolut file path": 0, "Image: Relative File path": 1, "Video stream (Falcon)": 2}, selected="Image: Relative File path")

# ---- group: Absolut Path
absolute_path = FilePath()

# ----
go_to_github = Button()
filter = StreamFilter(Gate=list, Stream0=absolute_path, Stream1=python, Stream2=dam)
current_file_path_or_video_stream = Panel(filter)

# ----
# 2) Output Parameters
# Scaling of
# input image
# Outputted Geometry
# Size of Geom.
# Color Effects
# Filter colors?
# For this color
# no geometry will
# be generated.
number_slider = Slider(5, range=0.5..5)
list_2 = ValueList({"Ratio based (beware with big IMG!)": 0, "Fixed Pixel Size": 1}, selected="Fixed Pixel Size")
ratio = Slider(0.05, range=0.01..1)
fixed_size = Slider(39, range=30..100)
list_3 = ValueList({"Circles": 1, "Triangles": 3, "Squares": 4, "Pentagons": 5, "Hexagons": 6, "Octogons": 8, "Form by Size": -1}, selected="Form by Size")
list_4 = ValueList({"Size by Lightness": 0, "Size by Darkness": 1, "Size by Saturation": 2}, selected="Size by Darkness")
list_5 = ValueList({"Original Colors": 1, "Inverted Colors": 2, "Greyscale": 4}, selected="Original Colors")
list_6 = ValueList({"None": 0, "Blacks": 1, "Whites": 2}, selected="None")
threshold_for_ignoring_colors = Slider(0.025, range=0..0.2)

reset = Button()
python_2 = GhPythonScript(port=reset)  # -> path
# ---------- python_2: Python ----------
""" Provide a method to get the accompanying 
    python code file. Replaces the 'file path' component
    which has no relative path option.
"""

from os import path


thisPath = path.normpath(ghenv.Component.Attributes.Owner.OnPingDocument().FilePath)

_split = path.split(thisPath)
_splitFile = _split[1].split(".")[0]

path_ = path.join(_split[0], _splitFile + ".py")
# ---------- end python_2 ----------
file = ReadFile(File=python_2, PerLineParse=False)
python_3 = GhPythonScript(
    Code=file,
    FilePath=filter,
    GridSize=number_slider,
    ResizeMethod=list_2,
    ResRatio=ratio,
    ResFix=fixed_size,
    GeomForm=list_3,
    SizeHSL=list_4,
    Fx_=list_5,
    Ignore=list_6,
    IgnoreThreshold=threshold_for_ignoring_colors)  # -> Debug, _pts, _geom, _origCol, _newCol, _BCol_
pt = Point(python_3._pts)
# _BCol_
# will automatically chose the right color stream for you, so the geometry will be styled appropiately.
crv = Curve(python_3._geom)
filter_2 = StreamFilter(Gate=python_3._BCol_, Stream0=python_3._origCol, Stream1=python_3._newCol)
# 3) Output Geometry
#      (shaded)
preview = CustomPreview(Geometry=crv, Material=filter_2)
