# Grasshopper definition cd1_08_bouncing_ball.gh (Grasshopper 1.0.7)

# Excercise 08: Bouncing Ball (Spring Pendulum)
# https://github.com/runxel/computational-design
# see also: https://github.com/runxel/grasshopper-examples
reset = Button()
origin_point_of_sphere = Point(Point(8.557300924, 11.48902008, 33.35748362))
fixpoint_of_spring = Point(Point(0, 0, 56.70081898))
drag_factor = Slider(0.99, range=0..2)
radius_of_sphere = Slider(3, range=0.1..10)
md_slider = MDSlider(
    SliderMode=0,
    slider_value=Point(0.6788398027, 0.2202453613, 0.5),
    x_domain=Domain(-1, 1),
    y_domain=Domain(-1, 1),
    z_domain=Domain(0, 1))
stiffness_k = Slider(67, range=1..100)
length_of_spring = Slider(14.7, range=1..20)
mass = Slider(50, range=1..100)
elasticity = Slider(0.8, range=0.1..1.2)
wind_force = Slider(20.6, range=1..100)
vec2pt = Vector2Pt(PointA=Point(0, 0, 0), PointB=md_slider, Unitize=False)  # -> Vector, Length
reset_2 = Button()
python = GhPythonScript(port=reset_2)  # -> path
# ---------- python: Python ----------
""" Provide a method to get the accompanying 
    python code file. Replaces the 'file path' component
    which has no relative path option.
"""

from os import path


thisPath = path.normpath(ghenv.Component.Attributes.Owner.OnPingDocument().FilePath)

_split = path.split(thisPath)
_splitFile = _split[1].split(".")[0]

path_ = path.join(_split[0], _splitFile + ".py")
# ---------- end python ----------
file = ReadFile(File=python, PerLineParse=False)
python_2 = PythonScript(
    Code=file,
    Reset=reset,
    PtOrigin=origin_point_of_sphere,
    PtSpring=fixpoint_of_spring,
    K=stiffness_k,
    L=length_of_spring,
    Mass=mass,
    DragFactor=drag_factor,
    Radius=radius_of_sphere,
    Elasticity=elasticity,
    WindVector=vec2pt.Vector,
    WindForce=wind_force)  # -> Out, _pos, _sphere
timer = Timer(TimerInterval=1, Target=python_2)  # disabled
go_to_github = Button()
orib = OpenRepoInBrowser(open=go_to_github)

# ---- group: VIZ
ln = Line(StartPoint=python_2._pos, EndPoint=fixpoint_of_spring)
rec = DataRecorder(python_2._pos, DataLimit=-10, RecordData=True)
amp = Amplitude(Vector=vec2pt.Vector, Amplitude=10)
vdis = VectorDisplay(Anchor=Point(0, 0, 0), Vector=amp)
preview = CustomPreview(Geometry=python_2._sphere, Shader=ColourSwatch(SwatchColor=RGB(19, 133, 240)))
intcrv = Interpolate(Vertices=rec, Degree=3, Periodic=False, KnotStyle=1)  # -> Curve, Length, Domain
preview_2 = CustomPreview(Geometry=ln, Shader=ColourSwatch(SwatchColor=RGB(37, 51, 64)))
preview_3 = CustomPreview(Geometry=intcrv.Curve, Shader=ColourSwatch(SwatchColor=RGB(230, 198, 18)))

# ----
panel = Panel(python_2.Out)

# ==== cluster OpenRepoInBrowser
open = ClusterInput()
python = GhPythonScript(open=open)
# ---------- python: Python ----------
""" A simple 'open in browser' script """

import webbrowser

url = "https://github.com/runxel/computational-design"

if open:
    webbrowser.open(url, new=2)
# ---------- end python ----------
