# Grasshopper definition cd1_09_mass_spring.gh (Grasshopper 1.0.7)

reset = Button()
python = GhPythonScript(port=reset)  # -> path
# ---------- python: Python ----------
""" Provide a method to get the accompanying 
    python code file. Replaces the 'file path' component
    which has no relative path option.
"""

from os import path


thisPath = path.normpath(ghenv.Component.Attributes.Owner.OnPingDocument().FilePath)

_split = path.split(thisPath)
_splitFile = _split[1].split(".")[0]

path_ = path.join(_split[0], _splitFile + "_b_cloth.py")
# ---------- end python ----------
reset_2 = Button()
python_2 = GhPythonScript(port=reset_2)  # -> path
# ---------- python_2: Python ----------
""" Provide a method to get the accompanying 
    python code file. Replaces the 'file path' component
    which has no relative path option.
"""

from os import path


thisPath = path.normpath(ghenv.Component.Attributes.Owner.OnPingDocument().FilePath)

_split = path.split(thisPath)
_splitFile = _split[1].split(".")[0]

path_ = path.join(_split[0], _splitFile + "_a_lines.py")
# ---------- end python_2 ----------
file = ReadFile(File=python, PerLineParse=False)

# ---- group: Cloth Simulation
run = BooleanToggle(False)
reset_3 = Button()
time_step = Slider(0.03, range=0.01..0.1)
number_of_rows = Slider(20, range=2..20)
distance_between_particles = Slider(0.6, range=0.01..1)
number_of_columns = Slider(20, range=2..20)
python_3 = GhPythonScript(
    Code=file,
    RUN=run,
    IsReset=reset_3,
    TimeInterval=time_step,
    NRows=number_of_rows,
    NColumns=number_of_columns,
    ParticleDistance=distance_between_particles)  # -> Out, _net

# ----
file_2 = ReadFile(File=python_2, PerLineParse=False)

# ---- group: Mass Spring System
# Excercise 09: Mass Spring
# https://github.com/runxel/computational-design
# see also: https://github.com/runxel/grasshopper-examples
run_simulation = BooleanToggle(False)
reset_simulation = Button()
list = ValueList({"Hanging springs": 1, "Bending springs": 2, "Hanging with random k": 3}, selected="Hanging springs")
move_position_of_endpoint = Slider(1, range=0.1..1)
number_of_segments = Slider(6, range=2..10)
mass_of_particle = Slider(1, range=0.1..1)
stiffness_of_spring = Slider(23, range=0..100)
damping = Slider(10, range=0..100)
time_interval = Slider(0.3, range=0.01..0.35)
crv = Curve(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)
python_4 = GhPythonScript(
    Code=file_2,
    RUN=run_simulation,
    IsReset=reset_simulation,
    Line=crv,
    System=list,
    PosEnd=move_position_of_endpoint,
    NSegments=number_of_segments,
    Mass=mass_of_particle,
    K=stiffness_of_spring,
    Damping=damping,
    TimeInterval=time_interval)  # -> Out, _particles

# ----
go_to_github = Button()
orib = OpenRepoInBrowser(open=go_to_github)
crv_2 = Curve(python_3._net)
panel = Panel(python_4.Out)
pline = PolyLine(Vertices=python_4._particles, Closed=False)

preview = CustomPreview(Geometry=crv_2, Material=ColourSwatch(SwatchColor=RGB(19, 36, 79)))

# ---- group: VIZ
symsim = SymbolSimple(Style=7, Size=10, Rotation=0, Colour=ColourSwatch(SwatchColor=RGB(0, 255, 149)))
preview_2 = CustomPreview(Geometry=crv, Material=ColourSwatch(SwatchColor=RGB(196, 196, 196)))
preview_3 = CustomPreview(Geometry=pline, Material=ColourSwatch(SwatchColor=RGB(19, 36, 79)))
symbol = SymbolDisplay(Location=python_4._particles, Display=symsim)

# ==== cluster OpenRepoInBrowser
open = ClusterInput()
python = GhPythonScript(open=open)
# ---------- python: Python ----------
""" A simple 'open in browser' script """

import webbrowser

url = "https://github.com/runxel/computational-design"

if open:
    webbrowser.open(url, new=2)
# ---------- end python ----------
