# Grasshopper definition cd1_10_agents.gh (Grasshopper 1.0.7)

run = BooleanToggle(False)
# CONVENTIONAL
reset = Button()
list = ValueList({"No Boundary": 0, "Floor": 1, "Boundary Box": 2, "Own boundary BREP": 3}, selected="No Boundary")
number_of_agents = Slider(20, range=1..20)
y_size = Slider(31.3, range=1..50)
max_visited_positions_1000 = Slider(1.8, range=1..5)

# ---- group: MODE SELECT
# Excercise 10: Agents
# https://github.com/runxel/computational-design
# see also: https://github.com/runxel/grasshopper-examples
# 1)
list_2 = ValueList({"Conventional": True, "Windows 95": False}, selected="Conventional")
vb = VBScript(Enable=list_2)
# ---------- vb: VB ----------
    Dim ghdoc As GH_Document = owner.OnPingDocument()
    If (ghdoc Is Nothing) Then Return

    For Each obj As IGH_DocumentObject In ghdoc.Objects
      If (obj.NickName.EndsWith("?")) Then
        If (TypeOf obj Is IGH_PreviewObject) Then
          DirectCast(obj, IGH_PreviewObject).Hidden = Not Enable
        End If
      End If
      If (obj.NickName.EndsWith("*")) Then
        If (TypeOf obj Is IGH_PreviewObject) Then
          DirectCast(obj, IGH_PreviewObject).Hidden = Enable
        End If
      End If
    Next
# ---------- end vb ----------

# ----
x_size = Slider(45.1, range=1..50)
z_size = Slider(17.7, range=1..50)
brep = Brep(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)
# If maxTime is set to zero, there will be no time constraint.
max_elapsed_time_in_sec = Slider(5, range=0..100)
# Windows 95
run_2 = BooleanToggle(False)
reset_2 = Button()
verbose = BooleanToggle(False)
pipe_radius = Slider(1, range=0..1)
# Advice:
# Best experienced when setting the Rhino
# viewport color to black, hide the grid
# via hitting 'F7' and using the command '_Fullscreen'  8-)
reset_3 = Button()
python = GhPythonScript(port=reset_3)  # -> path
# ---------- python: Python ----------
""" Provide a method to get the accompanying 
    python code file. Replaces the 'file path' component
    which has no relative path option.
"""

from os import path


thisPath = path.normpath(ghenv.Component.Attributes.Owner.OnPingDocument().FilePath)

_split = path.split(thisPath)
_splitFile = _split[1].split(".")[0]

path_ = path.join(_split[0], _splitFile + "_b_pipes.py")
# ---------- end python ----------
num = Number([x_size, y_size, z_size])
teapot = Brep(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)
file = ReadFile(File=python, PerLineParse=False)
go_to_github = Button()
reset_4 = Button()
python_2 = GhPythonScript(port=reset_4)  # -> path
# ---------- python_2: Python ----------
""" Provide a method to get the accompanying 
    python code file. Replaces the 'file path' component
    which has no relative path option.
"""

from os import path


thisPath = path.normpath(ghenv.Component.Attributes.Owner.OnPingDocument().FilePath)

_split = path.split(thisPath)
_splitFile = _split[1].split(".")[0]

path_ = path.join(_split[0], _splitFile + "_a.py")
# ---------- end python_2 ----------
python_3 = GhPythonScript(Code=file, RUN=run_2, IsReset=reset_2, Radius=pipe_radius, Verbose=verbose, Teapot=teapot)  # -> Out, _curPositions, _allPos, _colors, _pipes, _joints
file_2 = ReadFile(File=python_2, PerLineParse=False)
python_4 = GhPythonScript(
    Code=file_2,
    RUN=run,
    IsReset=reset,
    NAgents=number_of_agents,
    BoundaryType=list,
    FloorHeight=Slider(0, range=0..10),
    BBoxSize=num,
    BBREP=brep,
    MaxVisited=max_visited_positions_1000,
    MaxTime=max_elapsed_time_in_sec)  # -> Out, _curPositions, _allPos, _colors, _posColors, _helperGeo
orib = OpenRepoInBrowser(open=go_to_github)
panel = Panel(python_3.Out)
panel_2 = Panel(python_4.Out)

# ---- group: VIZ
pt = Point(python_3._curPositions)
col = Colour(python_3._colors)
geo = Geometry(python_3._pipes)
geo_2 = Geometry(python_3._joints)
preview = CustomPreview(Geometry=pt, Material=col)
preview_2 = CustomPreview(Geometry=[geo, geo_2], Material=graft(col))

box = CenterBox(Base=python_4._allPos, X="0.5", Y="0.5", Z="0.5")
pt_2 = Point(python_4._curPositions)
geo_3 = Geometry(python_4._helperGeo)
preview_3 = CustomPreview(Geometry=pt_2, Material=python_4._colors)
preview_4 = CustomPreview(
    Geometry=geo_3,
    Material={diffuse=RGB(255, 255, 255), emission=RGB(76, 76, 76), shine=0.5, specular=RGB(255, 255, 255), transparency=0})
preview_5 = CustomPreview(Geometry=box, Material=python_4._posColors)

# ==== cluster OpenRepoInBrowser
open = ClusterInput()
python = GhPythonScript(open=open)
# ---------- python: Python ----------
""" A simple 'open in browser' script """

import webbrowser

url = "https://github.com/runxel/computational-design"

if open:
    webbrowser.open(url, new=2)
# ---------- end python ----------
