# Grasshopper definition cd1_11_optimization.gh (Grasshopper 1.0.7)

# ---- group: Surface
# Excercise 11: Optimization
# https://github.com/runxel/computational-design
# see also: https://github.com/runxel/grasshopper-examples
# Find the shortest path on a surface between to points.
# This is achieved by moving two control points.
# (As a loose reference the Geodesic Curve component is used.
# Be aware that the actual results may differ, since geodesic curves
# are the shortest *straight* paths. A geodesic is defined to be a
# curve whose tangent vectors remain parallel.)
srf = Surface(reparameterize(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))
srf_2 = Surface(reparameterize(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))

# ---- group: Start Point <UV>
U = Slider(0.433, range=0..1)
V = Slider(0.704, range=0..1)

# ---- group: End Point <UV>
U_2 = Slider(0.711, range=0..1)
V_2 = Slider(0.102, range=0..1)

# ----
pt = ConstructPoint(XCoordinate=U, YCoordinate=V, ZCoordinate=0)
pt_2 = ConstructPoint(XCoordinate=U_2, YCoordinate=V_2, ZCoordinate=0)
go_to_github = Button()

# ---- group: Genepool
genes = GenePool(Decimals=3, Maximum=1, Minimum=0, Value=[0.487, 0.435, 0.572, 0.259])

# ----
orib = OpenRepoInBrowser(open=go_to_github)
# Galapagos Solution
srf_3 = Surface(srf)
pt_3 = Point(pt)
# Python Solution
pt_4 = Point(pt_2)
item = ListItem(List=genes, Index=0, Wrap=True)
item_2 = ListItem(List=genes, Index=1, Wrap=True)
item_3 = ListItem(List=genes, Index=2, Wrap=True)
item_4 = ListItem(List=genes, Index=3, Wrap=True)
niterations = Slider(1, range=1..15)
reset = Button()
python = GhPythonScript(port=reset)  # -> path
# ---------- python: Python ----------
""" Provide a method to get the accompanying 
    python code file. Replaces the 'file path' component
    which has no relative path option.
"""

from os import path


thisPath = path.normpath(ghenv.Component.Attributes.Owner.OnPingDocument().FilePath)

_split = path.split(thisPath)
_splitFile = _split[1].split(".")[0]

path_ = path.join(_split[0], _splitFile + ".py")
# ---------- end python ----------
pt_5 = ConstructPoint(XCoordinate=item, YCoordinate=item_2, ZCoordinate=0)
pt_6 = ConstructPoint(XCoordinate=item_3, YCoordinate=item_4, ZCoordinate=0)
srf_4 = Surface(srf)
fixpt1 = Point(pt)
fixpt2 = Point(pt_2)
file = ReadFile(File=python, PerLineParse=False)
evalsrf = EvaluateSurface(Surface=srf_3, Point=pt_3)  # -> Point, Normal, UDirection, VDirection, Frame
evalsrf_2 = EvaluateSurface(Surface=srf_3, Point=pt_5)  # -> Point, Normal, UDirection, VDirection, Frame
evalsrf_3 = EvaluateSurface(Surface=srf_3, Point=pt_6)  # -> Point, Normal, UDirection, VDirection, Frame
evalsrf_4 = EvaluateSurface(Surface=srf_3, Point=pt_4)  # -> Point, Normal, UDirection, VDirection, Frame
python_2 = GhPythonScript(Code=file, Surface=srf_4, FixPt1=fixpt1, FixPt2=fixpt2, NIterations=niterations)  # -> Out, _movPt1, _movPt2, _resultCrv
all_uv = Point([pt_3, pt_5, pt_6, pt_4])
pt_7 = Point(evalsrf.Point)
pt_8 = Point(evalsrf_2.Point)
pt_9 = Point(evalsrf_3.Point)
pt_10 = Point(evalsrf_4.Point)
pt_11 = Point(python_2._movPt1)
pt_12 = Point(python_2._movPt2)
crv = Curve(python_2._resultCrv)

# ---- group: Fitness
crvsrf = CurveOnSurface(Surface=srf_3, UVCoordinates=all_uv, Closed=False)  # -> Curve, Length, Domain
num = Number(crvsrf.Length)
panel = Panel(num)

# ----
panel_2 = Panel(python_2.Out)

len = Length(Curve=crv)
panel_3 = Panel(len)

galapagos = Galapagos(fitness=num, gene=genes)

# ---- group: Geodesic crv as reference
geodesic = Geodesic(Surface=srf_3, Start=pt_7, End=pt_10)
len_2 = Length(Curve=geodesic)
panel_4 = Panel(len_2)

# ----
iso = IsoCurve(Surface=srf, UVPoint=Point(0.5, 0.5, 0))  # -> UIsocurve, VIsocurve

# ---- group: V I Z / Surface
material = CreateMaterial(
    Diffuse=ColourSwatch(SwatchColor=RGB(191, 175, 50)),
    Specular=RGB(255, 255, 255),
    Emission=ColourSwatch(SwatchColor=RGB(84, 71, 15)),
    Transparency=0.3,
    Shine=0)
preview = CustomPreview(Geometry=[srf, iso.UIsocurve, iso.VIsocurve], Material=material)

# ---- group: V I Z / Movable Points
symsim = SymbolSimple(Style=11, Size=12, Rotation=degrees(-90), Colour=ColourSwatch(SwatchColor=RGB(255, 0, 0)))
symbol = SymbolDisplay(Location=[pt_9, pt_8], Display=symsim)

# ---- group: V I Z / Movable Points Python
symsim_2 = SymbolSimple(Style=11, Size=12, Rotation=degrees(-90), Colour=ColourSwatch(SwatchColor=RGB(0, 42, 255)))
symbol_2 = SymbolDisplay(Location=[pt_11, pt_12], Display=symsim_2)

# ---- group: V I Z / Python Crv
preview_2 = CustomPreview(Geometry=crv, Material=ColourSwatch(SwatchColor=RGB(0, 42, 255)))

# ---- group: V I Z / Start and End
symsim_3 = SymbolSimple(Style=13, Size=12, Rotation=0, Colour=ColourSwatch(SwatchColor=RGB(255, 255, 255)))
symbol_3 = SymbolDisplay(Location=[pt_10, pt_7], Display=symsim_3)

# ---- group: V I Z / Geodesic Crv
preview_3 = CustomPreview(Geometry=geodesic, Material=ColourSwatch(SwatchColor=RGB(166, 166, 166)))

# ---- group: V I Z / Galapagos Crv
preview_4 = CustomPreview(Geometry=crvsrf.Curve, Material=ColourSwatch(SwatchColor=RGB(255, 0, 0)))

# ==== cluster OpenRepoInBrowser
open = ClusterInput()
python = GhPythonScript(open=open)
# ---------- python: Python ----------
""" A simple 'open in browser' script """

import webbrowser

url = "https://github.com/runxel/computational-design"

if open:
    webbrowser.open(url, new=2)
# ---------- end python ----------
